# Grasshopper definition building_2.gh (Grasshopper 1.0.7)
# plug-ins: OpenNest, NGon

文件地址 = Panel("E:\GH-EX")
建筑单体编码 = Panel("1314_1_1")
ghpython_script = GhPythonScript(label_building=建筑单体编码, path_files=文件地址)  # -> print, path_exWalls_all, path_stairs_points, path_stairs_count, path_eles_points, path_eles_count, path_flats_points, path_flats_count, path_doors_all
# ---------- ghpython_script: Python ----------
__author__ = "18328"
__version__ = "2023.08.09"

import rhinoscriptsyntax as rs
import os

list_types_spaces = ['flats', 'eles', 'stairs','exWalls','doors']
list_type_data_1 =['points', 'count']
list_type_data_2 =['all']

list_paths = []

for type in list_types_spaces:
    if type in ['exWalls','doors']:
        list_type_data = list_type_data_2
    else:
        list_type_data = list_type_data_1
    
    for data in list_type_data:
        name_file = 'building_' + label_building.encode("utf-8") +'_'+ type +'_'+ data + '.txt'
        path_this = os.path.join(path_files, name_file)
        list_paths.append(path_this)
        
    
    
[path_flats_points, path_flats_count, path_eles_points, path_eles_count, path_stairs_points, path_stairs_count, path_exWalls_all, path_doors_all]= list_paths
# ---------- end ghpython_script ----------

文件地址_2 = Panel(ghpython_script.path_exWalls_all)
get_file_path = GetFilePath(文件地址_2, AtLeast=1, AtMost=1, TreeAccess=False)
read_file = ReadFile(File=get_file_path, PerLineParse=True)

文件地址_3 = Panel(ghpython_script.path_flats_points)
get_file_path_2 = GetFilePath(文件地址_3, AtLeast=1, AtMost=1, TreeAccess=False)
read_file_2 = ReadFile(File=get_file_path_2, PerLineParse=True)

文件地址_4 = Panel(ghpython_script.path_flats_count)
get_file_path_3 = GetFilePath(文件地址_4, AtLeast=1, AtMost=1, TreeAccess=False)
read_file_3 = ReadFile(File=get_file_path_3, PerLineParse=True)

文件地址_5 = Panel(ghpython_script.path_eles_points)
get_file_path_4 = GetFilePath(文件地址_5, AtLeast=1, AtMost=1, TreeAccess=False)
read_file_4 = ReadFile(File=get_file_path_4, PerLineParse=True)

文件地址_6 = Panel(ghpython_script.path_eles_count)
get_file_path_5 = GetFilePath(文件地址_6, AtLeast=1, AtMost=1, TreeAccess=False)
read_file_5 = ReadFile(File=get_file_path_5, PerLineParse=True)

文件地址_7 = Panel(ghpython_script.path_doors_all)
get_file_path_6 = GetFilePath(文件地址_7, AtLeast=1, AtMost=1, TreeAccess=False)
read_file_6 = ReadFile(File=get_file_path_6, PerLineParse=True)

文件地址_8 = Panel(ghpython_script.path_stairs_points)
get_file_path_7 = GetFilePath(文件地址_8, AtLeast=1, AtMost=1, TreeAccess=False)
read_file_7 = ReadFile(File=get_file_path_7, PerLineParse=True)

文件地址_9 = Panel(ghpython_script.path_stairs_count)
get_file_path_8 = GetFilePath(文件地址_9, AtLeast=1, AtMost=1, TreeAccess=False)
read_file_8 = ReadFile(File=get_file_path_8, PerLineParse=True)

panel = Panel(read_file_2)
panel_2 = Panel(read_file_3)
panel_3 = Panel(read_file_6)
panel_4 = Panel(read_file_8)
panel_5 = Panel(read_file_4)
panel_6 = Panel(read_file_7)
panel_7 = Panel(read_file)
panel_8 = Panel(read_file_5)

所有楼梯的角点 = Panel(panel_6)
每个楼梯角点的个数 = Panel(panel_4)
partition_list = PartitionList(List=所有楼梯的角点, Size=每个楼梯角点的个数)
楼梯的角点 = Panel(partition_list)

外墙层高 = Slider(3.3, range=0..10)
外墙的角点 = Panel(panel_7)

每个电梯角点的个数 = Panel(panel_8)
电梯的所有角点 = Panel(panel_5)
partition_list_2 = PartitionList(List=电梯的所有角点, Size=每个电梯角点的个数)
电梯的角点 = Panel(partition_list_2)

每个公寓角点的个数 = Panel(panel_2)
公寓的所有角点 = Panel(panel)
门的所有角点 = Panel(panel_3)

# ---- group: 字体设置
colour_rgb = ColourRGB(
    Alpha=Slider(255, range=0..255),
    Red=Slider(255, range=0..255),
    Green=Slider(255, range=0..255),
    Blue=Slider(255, range=0..255))

# ---- group: 文字&内墙
文字高出建筑高度 = Slider(0.5, range=0..10)
内墙高度 = Slider(3.4, range=0..10)
文字大小 = Slider(0.01, range=0.001..0.01)
字体 = Panel("Agency FB")
门高度 = Slider(2.7, range=0..10)
addition = Addition(A=内墙高度, B=文字高出建筑高度)

# ----
注释 = Panel("绘图的单位为m")

# ---- group: Flat wall
partition_list_3 = PartitionList(List=门的所有角点, Size=Slider(2, range=0..10))
panel_9 = Panel(partition_list_3)
polyline = PolyLine(Vertices=panel_9, Closed=False)
number_slider = Slider(0.5, range=0..1)
offset_curve = OffsetCurve(Curve=polyline, Distance=expr("-x", number_slider), Corners=1)
offset_curve_2 = OffsetCurve(Curve=polyline, Distance=number_slider, Corners=1)
end_points = EndPoints(Curve=offset_curve_2)  # -> Start, End
end_points_2 = EndPoints(Curve=offset_curve)  # -> Start, End
line = Line(StartPoint=end_points.End, EndPoint=end_points_2.End)
line_2 = Line(StartPoint=end_points.Start, EndPoint=end_points_2.Start)
unit_z = UnitZ(Factor=1)
# 各个楼的楼高
boundary_surfaces = BoundarySurfaces(Edges=[offset_curve_2, offset_curve, line_2, line])
amplitude = Amplitude(Vector=unit_z, Amplitude=门高度)
extrude = Extrude(Base=boundary_surfaces, Direction=amplitude)

# ----
flat = Slider(0.2, range=0..1)
flat_2 = Slider(0.3, range=0..1)
exwall = Slider(0.25, range=0..1)
exwall_2 = Slider(0.08, range=0..1)
stair = Slider(0.25, range=0..1)
ele = Slider(0.2, range=0..1)

number_slider_2 = Slider(154, range=0..255)
number_slider_3 = Slider(255, range=0..255)
number_slider_4 = Slider(200, range=0..255)
number_slider_5 = Slider(158, range=0..255)

# ---- group: Flat wall
partition_list_4 = PartitionList(List=公寓的所有角点, Size=每个公寓角点的个数)
panel_10 = Panel(partition_list_4)
polyline_2 = PolyLine(Vertices=panel_10, Closed=True)
unit_z_2 = UnitZ(Factor=1)
amplitude_2 = Amplitude(Vector=unit_z_2, Amplitude=内墙高度)

# ----
polyline_offset = PolylineOffset(Curve=polyline_2, Distance=flat_2, Divisions=0)  # -> C, H
polyline_offset_2 = PolylineOffset(Curve=polyline_2, Distance=flat, Divisions=0)  # -> C, H

# ---- group: Flat floor
boundary_surfaces_2 = BoundarySurfaces(Edges=polyline_offset_2.C)
unit_z_3 = UnitZ(Factor=Slider(0.1, range=0..0.1))
extrude_2 = Extrude(Base=boundary_surfaces_2, Direction=unit_z_3)
colour_rgb_2 = ColourRGB(
    Alpha=Slider(255, range=0..255),
    Red=Slider(255, range=0..255),
    Green=Slider(146, range=0..255),
    Blue=Slider(156, range=0..255))

# ---- group: Flat wall (continued)
boundary_surfaces_3 = BoundarySurfaces(Edges=[polyline_offset.C, polyline_offset_2.C])
extrude_3 = Extrude(Base=boundary_surfaces_3, Direction=amplitude_2)

boundary_surfaces_4 = BoundarySurfaces(Edges=polyline_2)
area = Area(Geometry=boundary_surfaces_4)  # -> Area, Centroid
expression = Expression(x=area.Centroid, y=addition, Expression="{x.x,x.y,x.z+y}")
solid_difference = SolidDifference(BrepsA=extrude_3, BrepsB=extrude)
text = Text(Location=expression, Text="Flat", Size=文字大小, Font=字体)
colour_rgb_3 = ColourRGB(
    Alpha=Slider(255, range=0..255),
    Red=Slider(255, range=0..255),
    Green=Slider(255, range=0..255),
    Blue=Slider(255, range=0..255))

# ----
注释_2 = Panel("ExWall")
polyline_3 = PolyLine(Vertices=外墙的角点, Closed=True)
# 太大就变形了
number_slider_6 = Slider(255, range=0..255)
unit_z_4 = UnitZ(Factor=1)
boundary_surfaces_5 = BoundarySurfaces(Edges=polyline_3)
amplitude_3 = Amplitude(Vector=unit_z_4, Amplitude=外墙层高)
colour_rgb_4 = ColourRGB(Alpha=Slider(255, range=0..255), Red=Slider(255, range=0..255), Green=Slider(255, range=0..255), Blue=number_slider_6)
colour_rgb_5 = ColourRGB(
    Alpha=Slider(255, range=0..255),
    Red=Slider(161, range=0..255),
    Green=Slider(217, range=0..255),
    Blue=Slider(155, range=0..255))

polyline_offset_3 = PolylineOffset(Curve=polyline_3, Distance=exwall_2, Divisions=0)  # -> C, H
polyline_offset_4 = PolylineOffset(Curve=polyline_3, Distance=exwall, Divisions=0)  # -> C, H
curve = Curve(polyline_3)

boundary_surfaces_6 = BoundarySurfaces(Edges=[polyline_offset_3.H, polyline_offset_4.C])
extrude_4 = Extrude(Base=boundary_surfaces_6, Direction=amplitude_3)

# ---- group: Stair
注释_3 = Panel("Stair")
polyline_4 = PolyLine(Vertices=楼梯的角点, Closed=True)
unit_z_5 = UnitZ(Factor=1)
amplitude_4 = Amplitude(Vector=unit_z_5, Amplitude=内墙高度)
colour_rgb_6 = ColourRGB(
    Alpha=Slider(255, range=0..255),
    Red=Slider(226, range=0..255),
    Green=Slider(176, range=0..255),
    Blue=Slider(124, range=0..255))

# ----
polyline_offset_5 = PolylineOffset(Curve=polyline_4, Distance=stair, Divisions=0)  # -> C, H

# ---- group: Stair (continued)
boundary_surfaces_7 = BoundarySurfaces(Edges=polyline_offset_5.C)
area_2 = Area(Geometry=boundary_surfaces_7)  # -> Area, expr("{x.x,x.y,x.z+1}", Centroid)
extrude_5 = Extrude(Base=boundary_surfaces_7, Direction=amplitude_4)
expression_2 = Expression(x=area_2.Centroid, y=addition, Expression="{x.x,x.y,x.z+y}")
text_2 = Text(Location=expression_2, Text="Stair", Size=文字大小, Font=字体)

# ---- group: Ele
注释_4 = Panel("Ele")
polyline_5 = PolyLine(Vertices=电梯的角点, Closed=True)
unit_z_6 = UnitZ(Factor=1)
amplitude_5 = Amplitude(Vector=unit_z_6, Amplitude=内墙高度)
colour_rgb_7 = ColourRGB(
    Alpha=Slider(255, range=0..255),
    Red=Slider(197, range=0..255),
    Green=Slider(219, range=0..255),
    Blue=Slider(239, range=0..255))

# ----
polyline_offset_6 = PolylineOffset(Curve=polyline_5, Distance=ele, Divisions=0)  # -> C, H
polyline_offset_7 = PolylineOffset(Curve=polyline_5, Distance=ele, Divisions=0)  # -> C, H

# ---- group: Ele (continued)
boundary_surfaces_8 = BoundarySurfaces(Edges=polyline_offset_6.C)
area_3 = Area(Geometry=boundary_surfaces_8)  # -> Area, expr("{x.x,x.y,x.z+1}", Centroid)
extrude_6 = Extrude(Base=boundary_surfaces_8, Direction=amplitude_5)
expression_3 = Expression(x=area_3.Centroid, y=addition, Expression="{x.x,x.y,x.z+y}")
text_3 = Text(Location=expression_3, Text="Ele", Size=文字大小, Font=字体)

# ---- group: 字体的边
boundary_surfaces_9 = BoundarySurfaces(Edges=text_2)
boundary_surfaces_10 = BoundarySurfaces(Edges=text_3)
boundary_surfaces_11 = BoundarySurfaces(Edges=text)

# ---- group: 最终的显示
# 地面
custom_preview = CustomPreview(Geometry=extrude_5, Material=colour_rgb_6)
custom_preview_2 = CustomPreview(Geometry=solid_difference, Material=colour_rgb_3)
custom_preview_3 = CustomPreview(Geometry=extrude_2, Material=colour_rgb_2)
custom_preview_4 = CustomPreview(Geometry=boundary_surfaces_10, Material=colour_rgb)
custom_preview_5 = CustomPreview(Geometry=extrude_6, Material=colour_rgb_7)
custom_preview_6 = CustomPreview(Geometry=boundary_surfaces_9, Material=colour_rgb)
custom_preview_7 = CustomPreview(Geometry=extrude_4, Material=colour_rgb_4)
custom_preview_8 = CustomPreview(Geometry=boundary_surfaces_11, Material=colour_rgb)
custom_preview_9 = CustomPreview(Geometry=boundary_surfaces_5, Material=colour_rgb_5)
