# Grasshopper definition flat_2_N.gh (Grasshopper 1.0.7)
# plug-ins: OpenNest, NGon

flat_name = Panel("2164")
path = Panel("E:\GH-EX")

data_type = Panel("points")
name_type = Panel("doors")

ghpython_script = GhPythonScript(path_save=path, name_flat=flat_name, name_type="outline", data_type=data_type)  # -> path_name_file_this
# ---------- ghpython_script: Python ----------
__author__ = "18328"
__version__ = "2023.08.11"

import rhinoscriptsyntax as rs
import os


name_file = 'flat_' + str(name_flat) + '_' + str(name_type) + '_' + str(data_type) + '.txt'
path_name_file_this = os.path.join(path_save, name_file)
print(path_name_file_this)
# ---------- end ghpython_script ----------
# 1. living room 不要，空白的地方是客厅
# 2. 单位是m
# 门取矩形的长轴中心线
# 外轮廓取外轮廓的角点
# 其他就是边以及对应的房间角点个数、编号、以及名称(简写)
panel = Panel(ghpython_script)
get_file_path = GetFilePath(panel, AtLeast=1, AtMost=1, TreeAccess=False)
read_file = ReadFile(File=get_file_path, PerLineParse=True)

ghpython_script_2 = GhPythonScript(path_save=path, name_flat=flat_name, name_type="living", data_type="count")  # -> path_name_file_this; same code as ghpython_script
panel_2 = Panel(ghpython_script_2)
get_file_path_2 = GetFilePath(panel_2, AtLeast=1, AtMost=1, TreeAccess=False)
read_file_2 = ReadFile(File=get_file_path_2, PerLineParse=True)

ghpython_script_3 = GhPythonScript(path_save=path, name_flat=flat_name, name_type="living", data_type=data_type)  # -> path_name_file_this; same code as ghpython_script
panel_3 = Panel(ghpython_script_3)
get_file_path_3 = GetFilePath(panel_3, AtLeast=1, AtMost=1, TreeAccess=False)
read_file_3 = ReadFile(File=get_file_path_3, PerLineParse=True)

ghpython_script_4 = GhPythonScript(path_save=path, name_flat=flat_name, name_type=name_type, data_type="lines")  # -> path_name_file_this; same code as ghpython_script
panel_4 = Panel(ghpython_script_4)
get_file_path_4 = GetFilePath(panel_4, AtLeast=1, AtMost=1, TreeAccess=False)
read_file_4 = ReadFile(File=get_file_path_4, PerLineParse=True)

ghpython_script_5 = GhPythonScript(path_save=path, name_flat=flat_name, name_type="normal_rooms", data_type=data_type)  # -> path_name_file_this; same code as ghpython_script
panel_5 = Panel(ghpython_script_5)
get_file_path_5 = GetFilePath(panel_5, AtLeast=1, AtMost=1, TreeAccess=False)
read_file_5 = ReadFile(File=get_file_path_5, PerLineParse=True)

ghpython_script_6 = GhPythonScript(path_save=path, name_flat=flat_name, name_type="normal_rooms", data_type="type")  # -> path_name_file_this; same code as ghpython_script
panel_6 = Panel(ghpython_script_6)
get_file_path_6 = GetFilePath(panel_6, AtLeast=1, AtMost=1, TreeAccess=False)
read_file_6 = ReadFile(File=get_file_path_6, PerLineParse=True)

ghpython_script_7 = GhPythonScript(path_save=path, name_flat=flat_name, name_type="normal_rooms", data_type="label")  # -> path_name_file_this; same code as ghpython_script
panel_7 = Panel(ghpython_script_7)
get_file_path_7 = GetFilePath(panel_7, AtLeast=1, AtMost=1, TreeAccess=False)
read_file_7 = ReadFile(File=get_file_path_7, PerLineParse=True)

ghpython_script_8 = GhPythonScript(path_save=path, name_flat=flat_name, name_type="normal_rooms", data_type="count")  # -> path_name_file_this; same code as ghpython_script
panel_8 = Panel(ghpython_script_8)
get_file_path_8 = GetFilePath(panel_8, AtLeast=1, AtMost=1, TreeAccess=False)
read_file_8 = ReadFile(File=get_file_path_8, PerLineParse=True)

trim_tree = TrimTree(Tree=read_file, Depth=1)
trim_tree_2 = TrimTree(Tree=read_file_4, Depth=1)
trim_tree_3 = TrimTree(Tree=read_file_2, Depth=1)
trim_tree_4 = TrimTree(Tree=read_file_3, Depth=1)
trim_tree_5 = TrimTree(Tree=read_file_5, Depth=1)
trim_tree_6 = TrimTree(Tree=read_file_7, Depth=1)
trim_tree_7 = TrimTree(Tree=read_file_8, Depth=1)
trim_tree_8 = TrimTree(Tree=read_file_6, Depth=1)
外墙多边形的角点 = Panel(trim_tree)
所有内门以及外门的线段 = Panel(trim_tree_2)

# ---- group: 内墙多边形
每个多边形的角点的个数 = Panel(trim_tree_7)
所有多边形的角点 = Panel(trim_tree_5)
每个多边形的标签名称 = Panel(trim_tree_8)
每个多边形的标签编号 = Panel(trim_tree_6)

# ----
每个客厅的角点的个数 = Panel(trim_tree_3)
所有客厅的角点 = Panel(trim_tree_4)

# ---- group: 文字
文字的高度 = Slider(4, range=0..10)
文字大小 = Slider(0.005, range=0.001..0.01)
字体 = Panel("Agency FB")

# ---- group: 内墙及门
# 都是向外扩张
门高 = Slider(2.1, range=0..10)
wall_height = Slider(3, range=0..10)
# 小
wall = Slider(0.1, range=0..1)
# 大
wall_2 = Slider(0.2, range=0..1)

# ---- group: 外墙
exwall = Slider(0.1, range=0..1)
exwall_height = Slider(3.2, range=0..10)
exwall_2 = Slider(0.3, range=0..1)

# ---- group: 门的洞口
partition_list = PartitionList(List=所有内门以及外门的线段, Size=Slider(2, range=0..10))
polyline = PolyLine(Vertices=partition_list, Closed=False)
wall_3 = Slider(0.7, range=0..1)
offset_curve = OffsetCurve(Curve=polyline, Distance=expr("-x", wall_3), Corners=1)
offset_curve_2 = OffsetCurve(Curve=polyline, Distance=wall_3, Corners=1)
end_points = EndPoints(Curve=offset_curve)  # -> Start, End
end_points_2 = EndPoints(Curve=offset_curve_2)  # -> Start, End
line = Line(StartPoint=end_points_2.Start, EndPoint=end_points.Start)
line_2 = Line(StartPoint=end_points_2.End, EndPoint=end_points.End)
boundary_surfaces = BoundarySurfaces(Edges=[line, line_2, offset_curve, offset_curve_2])
unit_z = UnitZ(Factor=1)
amplitude = Amplitude(Vector=unit_z, Amplitude=门高)
# IMPORTANT
extrude = Extrude(Base=boundary_surfaces, Direction=amplitude)  # -> flatten(Extrusion)

# ---- group: 墙体
partition_list_2 = PartitionList(List=所有多边形的角点, Size=每个多边形的角点的个数)
polyline_2 = PolyLine(Vertices=partition_list_2, Closed=True)
polyline_offset = PolylineOffset(Curve=polyline_2, Distance=wall, Divisions=0)  # -> C, H
polyline_offset_2 = PolylineOffset(Curve=polyline_2, Distance=wall_2, Divisions=0)  # -> C, H
boundary_surfaces_2 = BoundarySurfaces(Edges=[polyline_offset.C, polyline_offset_2.C])
unit_z_2 = UnitZ(Factor=1)
amplitude_2 = Amplitude(Vector=unit_z_2, Amplitude=wall_height)
extrude_2 = Extrude(Base=boundary_surfaces_2, Direction=amplitude_2)

# ----
partition_list_3 = PartitionList(List=所有客厅的角点, Size=每个客厅的角点的个数)
polyline_3 = PolyLine(Vertices=partition_list_3, Closed=True)
boundary_surfaces_3 = BoundarySurfaces(Edges=polyline_3)
area = Area(Geometry=boundary_surfaces_3)  # -> Area, Centroid
expression = Expression(x=area.Centroid, y=文字的高度, Expression="{x.x,x.y,x.z+y}")
text = Text(Location=expression, Text="Living", Size=文字大小, Font=字体)
boundary_surfaces_4 = BoundarySurfaces(Edges=text)

# ---- group: Exterior wall
# 都使用了内部的offside
polyline_4 = PolyLine(Vertices=外墙多边形的角点, Closed=True)
polyline_offset_3 = PolylineOffset(Curve=polyline_4, Distance=exwall_2, Divisions=0)  # -> C, H
polyline_offset_4 = PolylineOffset(Curve=polyline_4, Distance=exwall, Divisions=0)  # -> C, H
boundary_surfaces_5 = BoundarySurfaces(Edges=[polyline_offset_3.H, polyline_offset_4.H])
unit_z_3 = UnitZ(Factor=1)
amplitude_3 = Amplitude(Vector=unit_z_3, Amplitude=exwall_height)
extrude_3 = Extrude(Base=boundary_surfaces_5, Direction=amplitude_3)

# ----
boundary_surfaces_6 = BoundarySurfaces(Edges=polyline_offset.C)
unit_z_4 = UnitZ(Factor=0.1)
extrude_4 = Extrude(Base=boundary_surfaces_6, Direction=unit_z_4)
multiplication = Multiplication(A=graft(每个多边形的标签编号), B=Slider(12, range=0..100))

boundary_surfaces_7 = BoundarySurfaces(Edges=polyline_offset_3.H)
unit_z_5 = UnitZ(Factor=0)
extrude_5 = Extrude(Base=boundary_surfaces_7, Direction=unit_z_5)

area_2 = Area(Geometry=boundary_surfaces_6)  # -> Area, Centroid
expression_2 = Expression(x=area_2.Centroid, y=文字的高度, Expression="{x.x,x.y,x.z+y}")
text_2 = Text(Location=expression_2, Text=graft(每个多边形的标签名称), Size=文字大小, Font=字体)
boundary_surfaces_8 = BoundarySurfaces(Edges=text_2)

colour_rgb = ColourRGB(
    Alpha=Slider(255, range=0..255),
    Red=Slider(255, range=0..255),
    Green=Slider(255, range=0..255),
    Blue=Slider(255, range=0..255))

colour_rgb_2 = ColourRGB(
    Alpha=Slider(255, range=0..255),
    Red=Slider(255, range=0..255),
    Green=Slider(255, range=0..255),
    Blue=Slider(255, range=0..255))

solid_difference = SolidDifference(BrepsA=extrude_2, BrepsB=extrude)
colour_rgb_3 = ColourRGB(
    Alpha=Slider(255, range=0..255),
    Red=Slider(255, range=0..255),
    Green=Slider(255, range=0..255),
    Blue=Slider(255, range=0..255))

gradient = Gradient(
    LowerLimit=0,
    UpperLimit=255,
    Parameter=multiplication,
    stops=[0.0278: RGB(234, 126, 0), 0.4: RGB(254, 244, 84), 0.487: RGB(0, 255, 0), 0.734: RGB(75, 107, 169), 1: RGB(234, 38, 0)])

# ---- group: 外墙
solid_difference_2 = SolidDifference(BrepsA=extrude_3, BrepsB=extrude)
colour_rgb_4 = ColourRGB(
    Alpha=Slider(255, range=0..255),
    Red=Slider(255, range=0..255),
    Green=Slider(255, range=0..255),
    Blue=Slider(255, range=0..255))

# ----
colour_rgb_5 = ColourRGB(
    Alpha=Slider(255, range=0..255),
    Red=Slider(85, range=0..255),
    Green=Slider(118, range=0..255),
    Blue=Slider(214, range=0..255))

custom_preview = CustomPreview(Geometry=boundary_surfaces_8, Material=colour_rgb_2)
# 地面
custom_preview_2 = CustomPreview(Geometry=solid_difference_2, Material=colour_rgb_4)
custom_preview_3 = CustomPreview(Geometry=solid_difference, Material=colour_rgb_3)
custom_preview_4 = CustomPreview(Geometry=extrude_5, Material=colour_rgb_5)
custom_preview_5 = CustomPreview(Geometry=extrude_4, Material=gradient)
custom_preview_6 = CustomPreview(Geometry=boundary_surfaces_4, Material=colour_rgb)
