# Grasshopper definition site_3.gh (Grasshopper 1.0.7)

注释 = Panel("绘图的单位为m")
城市编码 = Panel("11_61ef8a9332b5d4672152e27e")
文件地址 = Panel("E:\GH-EX")
文件地址_2 = Panel("E:\GH-EX")
城市编码_2 = Panel("11_61ef8a9332b5d4672152e27e")
ghpython_script = GhPythonScript(label_city=城市编码, path_files=文件地址)  # -> print, path_points, path_count, path_floors
# ---------- ghpython_script: Python ----------
__author__ = "18328"
__version__ = "2023.08.09"

import rhinoscriptsyntax as rs
import os

list_paths = []
for type in ['_points','_amount','_floors',]:
    name_file = 'site_' + label_city.encode("utf-8") + type + '.txt'
    path_this = os.path.join(path_files, name_file)
    list_paths.append(path_this)
path_points, path_count, path_floors = list_paths
# ---------- end ghpython_script ----------
ghpython_script_2 = GhPythonScript(label_city=城市编码_2, path_files=文件地址_2)  # -> print, path_boundary
# ---------- ghpython_script_2: Python ----------
__author__ = "18328"
__version__ = "2023.08.09"

import rhinoscriptsyntax as rs
import os

name_file = 'site_' + label_city.encode("utf-8")  + '_boundary.txt'
path_boundary = os.path.join(path_files, name_file)
print(path_boundary)
# ---------- end ghpython_script_2 ----------
文件地址_3 = Panel(ghpython_script.path_floors)
文件地址_4 = Panel(ghpython_script.path_count)
文件地址_5 = Panel(ghpython_script.path_points)
panel = Panel(ghpython_script_2.path_boundary)
get_file_path = GetFilePath(panel, AtLeast=1, AtMost=1, TreeAccess=False)
get_file_path_2 = GetFilePath(文件地址_5, AtLeast=1, AtMost=1, TreeAccess=False)
get_file_path_3 = GetFilePath(文件地址_4, AtLeast=1, AtMost=1, TreeAccess=False)
get_file_path_4 = GetFilePath(文件地址_3, AtLeast=1, AtMost=1, TreeAccess=False)
read_file = ReadFile(File=get_file_path, PerLineParse=True)
read_file_2 = ReadFile(File=get_file_path_2, PerLineParse=True)
read_file_3 = ReadFile(File=get_file_path_4, PerLineParse=True)
read_file_4 = ReadFile(File=get_file_path_3, PerLineParse=True)

# ----
# 场地的几何角点
# 所有楼底座的几何角点
# 每个楼的底座的几何角点的个数
# 每个楼的层高
panel_3 = Panel(read_file)
panel_4 = Panel(read_file_3)
panel_5 = Panel(read_file_2)
panel_6 = Panel(read_file_4)

# ----
# 每个楼的几何底座
partition_list = PartitionList(List=panel_5, Size=panel_6)
panel_7 = Panel(partition_list)

层高 = Slider(3, range=0..10000)

# ----
# 每个楼的层高区域
# 每个楼的层高列表
# 每个楼的层数列表
construct_domain = ConstructDomain(DomainStart=0, DomainEnd=panel_4)  # -> graft(Domain)
range = Range(Domain=construct_domain, Steps=graft(panel_4))
multiplication = Multiplication(A=层高, B=range)
panel_8 = Panel(multiplication)

# ----
# 各个楼的楼高
multiplication_2 = Multiplication(A=panel_4, B=层高)
panel_9 = Panel(multiplication_2)
polyline = PolyLine(Vertices=panel_7, Closed=Toggle(True))
panel_10 = Panel("整个楼栋几何")
unit_z = UnitZ(Factor=1)
curve = Curve(polyline)
boundary_surfaces = BoundarySurfaces(Edges=curve)
amplitude = Amplitude(Vector=unit_z, Amplitude=panel_9)  # -> graft(Vector)
extrude = Extrude(Base=boundary_surfaces, Direction=amplitude)
colour_rgb = ColourRGB(Alpha=255, Red=Slider(255, range=0..255), Green=Slider(255, range=0..255), Blue=Slider(255, range=0..255))

polyline_2 = PolyLine(Vertices=panel_7, Closed=Toggle(True))
panel_11 = Panel("分层")
curve_2 = Curve(polyline_2)
伸出层檐的宽度 = Slider(0.05, range=0..5)
offset_curve = OffsetCurve(Curve=curve_2, Distance=expr("-X", 伸出层檐的宽度), Corners=1)
offset_curve_2 = OffsetCurve(Curve=curve_2, Distance=伸出层檐的宽度, Corners=1)
boundary_surfaces_2 = BoundarySurfaces(Edges=[offset_curve_2, offset_curve])
层檐的厚度 = Slider(0.208, range=0..10)
unit_z_2 = UnitZ(Factor=1)
# 平移的距离减少些，防止露出
subtraction = Subtraction(A=panel_8, B=层檐的厚度)
unit_z_3 = UnitZ(Factor=1)
amplitude_2 = Amplitude(Vector=unit_z_2, Amplitude=层檐的厚度)
amplitude_3 = Amplitude(Vector=unit_z_3, Amplitude=subtraction)
move = Move(Geometry=boundary_surfaces_2, Motion=amplitude_3)  # -> Geometry, Transform
# move & extrude
number_slider = Slider(255, range=0..255)
extrude_2 = Extrude(Base=move.Geometry, Direction=amplitude_2)
colour_rgb_2 = ColourRGB(Alpha=number_slider, Red=Slider(113, range=0..255), Green=Slider(152, range=0..255), Blue=Slider(209, range=0..255))

polyline_3 = PolyLine(Vertices=panel_3, Closed=Toggle(True))
curve_3 = Curve(polyline_3)
offset_curve_3 = OffsetCurve(Curve=curve_3, Distance=expr("-x", Slider(259, range=0..910)), Corners=1)  # disabled
offset_curve_4 = OffsetCurve(Curve=curve_3, Distance=Slider(0, range=0..10), Corners=1)
panel_12 = Panel("场地")
boundary_surfaces_3 = BoundarySurfaces(Edges=curve_3)
unit_z_4 = UnitZ(Factor=1)
amplitude_4 = Amplitude(Vector=unit_z_4, Amplitude=Slider(0.034, range=0..1))
extrude_3 = Extrude(Base=boundary_surfaces_3, Direction=amplitude_4)
colour_rgb_3 = ColourRGB(
    Alpha=Slider(255, range=0..255),
    Red=Slider(252, range=0..255),
    Green=Slider(233, range=0..255),
    Blue=Slider(115, range=0..255))

custom_preview = CustomPreview(Geometry=extrude, Material=colour_rgb)
custom_preview_2 = CustomPreview(Geometry=extrude_3, Material=colour_rgb_3)
custom_preview_3 = CustomPreview(Geometry=extrude_2, Material=colour_rgb_2)
